# Grasshopper definition Simple workflow.gh (Grasshopper 1.0.8)
# plug-ins: JLP.Components, JLP

appartment1 = DefineSpace(ParentID="Groundfloor", Colour=RGB(255, 0, 0), Area=12, LockTransform=True)  # -> SpaceID, Guid
panel = Panel("""Kitchen
Hallway""")
panel_2 = Panel("""Livingroom
Bedroom
Bathroom""")
livingroom = DefineSpace(ParentID=appartment1.SpaceID, Colour=ColourSwatch(SwatchColor=RGB(247, 255, 0)), Area=16, AdjacentIDs=panel)  # -> SpaceID, Guid
bedroom = DefineSpace(ParentID=appartment1.SpaceID, Colour=ColourSwatch(SwatchColor=RGB(74, 184, 0)), Area=12, AdjacentIDs="Hallway")  # -> SpaceID, Guid
hallway = DefineSpace(ParentID=appartment1.SpaceID, Colour=ColourSwatch(SwatchColor=RGB(255, 126, 255)), Area=5, AdjacentIDs=panel_2)  # -> SpaceID, Guid
kitchen = DefineSpace(ParentID=appartment1.SpaceID, Colour=ColourSwatch(SwatchColor=RGB(255, 0, 0)), Area=4, AdjacentIDs="Livingroom")  # -> SpaceID, Guid
bathroom = DefineSpace(ParentID=appartment1.SpaceID, Colour=ColourSwatch(SwatchColor=RGB(0, 0, 255)), Area=5, AdjacentIDs="Hallway")  # -> SpaceID, Guid
api_key = APIKey("_DxOsZDJLXZEyIicfGLfI9gMt_KHpFFXaWDwknh7Wx4")
floorplanquery = FloorplanQuery(SpaceID=appartment1.SpaceID, APIKey=api_key)  # -> Data, InstructionJSON, Colours
create_material = CreateMaterial(Diffuse=floorplanquery.Colours, Specular=RGB(0, 0, 0), Emission=RGB(0, 0, 0), Transparency=0, Shine=0)
data2boundary = Data2Boundary(Data=floorplanquery.Data, InstructionJSON=floorplanquery.InstructionJSON, Smoothing=2)  # -> Edges, Adjacencies
flip_matrix = FlipMatrix(Data=data2boundary.Adjacencies)
cull_pattern = CullPattern(List=data2boundary.Edges, CullPattern=flip_matrix)
join_curves = JoinCurves(Curves=simplify(cull_pattern), Preserve=False)  # -> simplify(flatten(Curves))
cull_index = CullIndex(List=join_curves, Indices=-1, Wrap=True)
boundary_surfaces = BoundarySurfaces(Edges=graft(cull_index))  # -> flatten(Surfaces)
custom_preview = CustomPreview(Geometry=boundary_surfaces, Material=create_material)
